# Grasshopper definition ARCH_TheParthenon_101.gh (Grasshopper 1.0.7)

rectangle = Slider(3.7, range=0..4)
rectangle_2 = Slider(3.63, range=0..4)
datatree_grid = Slider(3.7, range=0..4)
datatree_grid_2 = Slider(3.62, range=0..4)

base_column_radii = Slider(1, range=0..2)

# ----
# floorplan
geometry = Geometry(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)

radius_of_quad_sphere = Slider(57, range=0..100)
# Rectangular plan
# 102 x 226 feet (31 x 69 meters)
# 
# The peristyle, the range of 8 by 17 columns surrounding
# the temple, contains two rooms.
# 
# The larger room, or naos, with its inner supporting colonnade
# accomodated the statue of the patron goddess, Athena
# Relief panels of the frieze and portico.
# 
# Entasis, to maintain an appearance of exact alignment.
# 
# Apparently perpendicular and horizontal lines are, in fact,
# set out within curved and inclining planes,
# to correct the optical illusion of perspective distortion.
multiplication = Multiplication(A=base_column_radii, B=datatree_grid)
multiplication_2 = Multiplication(A=base_column_radii, B=datatree_grid_2)
area = Area(Geometry=geometry)  # -> Area, Centroid
construct_domain = ConstructDomain(DomainStart=0, DomainEnd=multiplication)
construct_domain_2 = ConstructDomain(DomainStart=0, DomainEnd=multiplication_2)
# The Parthenon
# The Parthenon (447-432 BC) by Ictinus and Callicrates
# Acropolis in Athens
# Greatest monument of the Hellenic period (650-323 BC)
# Doric Temple
plane = Plane(PlaneXY(0, 0, 0))
radius = Radius(base_column_radii)
quad_sphere = QuadSphere(Base=area.Centroid, Radius=radius_of_quad_sphere)

# ---- group: column grid
multiplication_3 = Multiplication(A=base_column_radii, B="17")
multiplication_4 = Multiplication(A=base_column_radii, B="8")

# ----
circle = Circle(Plane=plane, Radius=radius)
rectangle_3 = Rectangle(Plane=PlaneXY(0, 0, 0), XSize=construct_domain, YSize=construct_domain_2, Radius=0)  # -> Rectangle, Length
deconstruct_brep = DeconstructBrep(Brep=quad_sphere)  # -> Faces, Edges, Vertices
list_item = ListItem(List=deconstruct_brep.Faces, Index=0, Wrap=True)
rectangular_array = RectangularArray(Geometry=circle, Cell=rectangle_3.Rectangle, XCount=multiplication_3, YCount=multiplication_4)  # -> Geometry, Transform
rectangular = Rectangular(
    Plane=PlaneXY(0, 0, 0),
    SizeX=construct_domain,
    SizeY=construct_domain_2,
    ExtentX=expr("x-1", multiplication_3),
    ExtentY=expr("x-1", multiplication_4))  # -> Cells, Points
unit_z = UnitZ(Factor=Slider(68, range=0..100))
move = Move(Geometry=rectangular_array.Geometry, Motion=unit_z)  # -> Geometry, Transform

# ----
# floorplan projected illusion
project = Project(Curve=rectangular_array.Geometry, Brep=list_item, Direction=Vector(0, 0, 1))

geometry_2 = Geometry(graft(move.Geometry))
loft = Loft(
    Curves=[geometry_2, project],
    Options={Adjust=False, Closed=False, LoftEnds=0, LoftSimp=0, LoftType=0, Rebuild=10, Refit=0.01})
