# Grasshopper definition ARCH_TheParthenon_101d.gh (Grasshopper 1.0.7)

base_column_radii = Slider(1, range=0..2)

rectangle = Slider(3.7, range=0..4)
rectangle_2 = Slider(3.63, range=0..4)
datatree_grid = Slider(3.7, range=0..4)
datatree_grid_2 = Slider(3.62, range=0..4)

# ----
# floorplan
geometry = Geometry(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)

radius_of_quad_sphere = Slider(100, range=0..100)
# Rectangular plan
# 102 x 226 feet (31 x 69 meters)
# 
# The peristyle, the range of 8 by 17 columns surrounding
# the temple, contains two rooms.
# 
# The larger room, or naos, with its inner supporting colonnade
# accomodated the statue of the patron goddess, Athena
# Relief panels of the frieze and portico.
# 
# Entasis, to maintain an appearance of exact alignment.
# 
# Apparently perpendicular and horizontal lines are, in fact,
# set out within curved and inclining planes,
# to correct the optical illusion of perspective distortion.
multiplication = Multiplication(A=base_column_radii, B=datatree_grid)
multiplication_2 = Multiplication(A=base_column_radii, B=datatree_grid_2)
area = Area(Geometry=geometry)  # -> Area, Centroid
construct_domain = ConstructDomain(DomainStart=0, DomainEnd=multiplication)
construct_domain_2 = ConstructDomain(DomainStart=0, DomainEnd=multiplication_2)
# The Parthenon
# The Parthenon (447-432 BC) by Ictinus and Callicrates
# Acropolis in Athens
# Greatest monument of the Hellenic period (650-323 BC)
# Doric Temple
plane = Plane(PlaneXY(0, 0, 0))
radius = Radius(base_column_radii)
quad_sphere = QuadSphere(Base=area.Centroid, Radius=radius_of_quad_sphere)

# ---- group: column grid
multiplication_3 = Multiplication(A=base_column_radii, B="17")
multiplication_4 = Multiplication(A=base_column_radii, B="8")

# ----
circle = Circle(Plane=plane, Radius=radius)
rectangle_3 = Rectangle(Plane=PlaneXY(0, 0, 0), XSize=construct_domain, YSize=construct_domain_2, Radius=0)  # -> Rectangle, Length
deconstruct_brep = DeconstructBrep(Brep=quad_sphere)  # -> Faces, Edges, Vertices
list_item = ListItem(List=deconstruct_brep.Faces, Index=0, Wrap=True)
rectangular_array = RectangularArray(Geometry=circle, Cell=rectangle_3.Rectangle, XCount=multiplication_3, YCount=multiplication_4)  # -> Geometry, Transform
panel = Panel("""{0;0;0}[0,7]
{0;0;16}[0,7]""")
rectangular = Rectangular(
    Plane=PlaneXY(0, 0, 0),
    SizeX=construct_domain,
    SizeY=construct_domain_2,
    ExtentX=expr("x-1", multiplication_3),
    ExtentY=expr("x-1", multiplication_4))  # -> Cells, Points
boolean_toggle = BooleanToggle(True)
param_viewer = ParamViewer(rectangular.Points)
split_tree = SplitTree(Data=rectangular.Points, Masks=flatten(panel))  # -> Positive, Negative
panel_2 = Panel("""{0;0;0}[1..6]
{0;0;16}[1..6]""")
point = Point(rectangular.Points)
panel_3 = Panel("""{0;0;*}[0]
{0;0;*}[7]""")
geometry_2 = Geometry(split_tree.Negative)
geometry_3 = Geometry(split_tree.Positive)
geometry_4 = Geometry(split_tree.Negative)
split_tree_2 = SplitTree(Data=point, Masks=flatten(panel_2))  # -> Positive, Negative
panel_4 = Panel(split_tree.Positive)
param_viewer_2 = ParamViewer(geometry_4)
clean_tree = CleanTree(RemoveNulls=True, RemoveInvalid=True, RemoveEmpty=boolean_toggle, Tree=geometry_3)
point_2 = Point(split_tree_2.Positive)
clean_tree_2 = CleanTree(RemoveNulls=True, RemoveInvalid=True, RemoveEmpty=boolean_toggle, Tree=split_tree_2.Positive)
split_tree_3 = SplitTree(Data=geometry_4, Masks=flatten(panel_3))  # -> Positive, Negative
geometry_5 = Geometry(clean_tree)
geometry_6 = Geometry(clean_tree_2)
geometry_7 = Geometry(split_tree_3.Positive)
merge = Merge(Data1=geometry_5, Data2=geometry_7)  # -> flatten(Result)
clean_tree_3 = CleanTree(RemoveNulls=True, RemoveInvalid=True, RemoveEmpty=boolean_toggle, Tree=merge)
circle_2 = Circle(Plane=clean_tree_3, Radius=1)
clean_tree_4 = CleanTree(RemoveNulls=True, RemoveInvalid=True, RemoveEmpty=False, Tree=circle_2)
list_length = ListLength(List=flatten(clean_tree_4))
construct_domain_3 = ConstructDomain(DomainStart=Slider(10, range=0..10), DomainEnd=Slider(10, range=0..10))
range = Range(Domain=construct_domain_3, Steps=expr("x-1", list_length))

# ----
# floorplan projected illusion
project = Project(Curve=clean_tree_4, Brep=list_item, Direction=Vector(0, 0, 1))

unit_z = UnitZ(Factor=range)
move = Move(Geometry=project, Motion=graft(unit_z))  # -> Geometry, Transform
area_2 = Area(Geometry=clean_tree_4)  # -> Area, graft(Centroid)
unit_z_2 = UnitZ(Factor=Slider(10, range=0..10))
scale = Scale(Geometry=move.Geometry, Center=area_2.Centroid, Factor=Slider(1.089, range=0.109..1.15))  # -> Geometry, Transform
negative = Negative(Value=unit_z_2)
move_2 = Move(Geometry=scale.Geometry, Motion=negative)  # -> Geometry, Transform
merge_2 = Merge(Data1=project, Data2=move_2.Geometry, Data3=move.Geometry)
loft = Loft(Curves=merge_2, Options={Adjust=False, Closed=False, LoftEnds=0, LoftSimp=0, LoftType=0, Rebuild=10, Refit=0.01})
