# Grasshopper definition ARCH_TheParthenon_202.gh (Grasshopper 1.0.7)

# ----
# The Parthenon
# The Parthenon (447-432 BC) by Ictinus and Callicrates
# Acropolis in Athens
# Greatest monument of the Hellenic period (650-323 BC)
# Doric Temple
# Import, scale, and center reference image.
# Set to layer, make transparent, and lock.
geometry = Geometry(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)
area = Area(Geometry=geometry)  # -> Area, Centroid
deconstruct_brep = DeconstructBrep(Brep=geometry)  # -> Faces, Edges, Vertices
point = Point(area.Centroid)
surface = Surface(deconstruct_brep.Faces)
brep = Brep(deconstruct_brep.Faces)
curve = Curve(deconstruct_brep.Edges)
point_2 = Point(deconstruct_brep.Vertices)
deconstruct = Deconstruct(Point=point)  # -> XComponent, YComponent, ZComponent
construct_point = ConstructPoint(XCoordinate=deconstruct.XComponent, YCoordinate=deconstruct.YComponent, ZCoordinate=deconstruct.ZComponent)
construct_plane = ConstructPlane(Origin=construct_point, XAxis=Vector(1, 0, 0), YAxis=Vector(0, 1, 0))
plane = Plane(construct_plane)

# ----
# Steps:
# The steps have a curved profile,
# rising towards the center.
# The treads are set witha slight upward tilt.
# The devices of perspective correction produce a
# complex geometry for construction.
number_slider = Slider(1.02, range=1..2)
number_slider_2 = Slider(1.01428, range=1..1.03)
curve_2 = Curve(curve)
plane_2 = Plane(plane)
join_curves = JoinCurves(Curves=curve_2, Preserve=False)
negative = Negative(Value=Slider(0.11, range=0..2))
multiplication = Multiplication(A="1", B=number_slider_2)
multiplication_2 = Multiplication(A="1", B=number_slider_2)
construct_domain = ConstructDomain(DomainStart="1", DomainEnd=number_slider)
construct_domain_2 = ConstructDomain(DomainStart="1", DomainEnd=Slider(1.03, range=1..2))
construct_domain_3 = ConstructDomain(DomainStart="0", DomainEnd=negative)
number_slider_3 = Slider(1, range=0..10)
range = Range(Domain=construct_domain, Steps=number_slider_3)
range_2 = Range(Domain=construct_domain_2, Steps=number_slider_3)
range_3 = Range(Domain=construct_domain_3, Steps=number_slider_3)
unit_z = UnitZ(Factor=range_3)
unit_z_2 = UnitZ(Factor=multiplication)

scale_nu = ScaleNU(Geometry=join_curves, Plane=plane_2, ScaleX=range, ScaleY=range_2, ScaleZ=1)  # -> Geometry, Transform
move = Move(Geometry=scale_nu.Geometry, Motion=unit_z)  # -> Geometry, Transform
cull_index = CullIndex(List=scale_nu.Geometry, Indices="-1", Wrap=True)
cull_index_2 = CullIndex(List=move.Geometry, Indices="0", Wrap=True)
explode = Explode(Curve=cull_index, Recursive=True)  # -> graft(Segments), Vertices
explode_2 = Explode(Curve=cull_index_2, Recursive=True)  # -> graft(Segments), Vertices
negative_2 = Negative(Value=unit_z_2)
loft = Loft(
    Curves=[explode.Segments, explode_2.Segments],
    Options={Adjust=False, Closed=False, LoftEnds=0, LoftSimp=0, LoftType=0, Rebuild=10, Refit=0.01})
join_curves_2 = JoinCurves(Curves=flatten(explode_2.Segments), Preserve=False)
scale_nu_2 = ScaleNU(Geometry=join_curves_2, Plane=plane_2, ScaleX=multiplication, ScaleY=multiplication_2, ScaleZ=1)  # -> Geometry, Transform
move_2 = Move(Geometry=scale_nu_2.Geometry, Motion=negative_2)  # -> Geometry, Transform
explode_3 = Explode(Curve=move_2.Geometry, Recursive=True)  # -> Segments, Vertices
explode_4 = Explode(Curve=join_curves_2, Recursive=True)  # -> Segments, Vertices
line = Line(StartPoint=explode_4.Vertices, EndPoint=explode_3.Vertices)
curve_middle = CurveMiddle(Curve=line)
scale = Scale(Geometry=curve_middle, Center=Point(0, 0, 0), Factor=Slider(1.003576, range=1.000999..1.011))  # -> Geometry, Transform
arc_3pt = Arc3Pt(PointA=explode_4.Vertices, PointB=scale.Geometry, PointC=explode_3.Vertices)  # -> Arc, Plane, Radius
list_item = ListItem(List=arc_3pt.Arc, Index=0, Wrap=True)  # -> Item, Item1, Item2, Item3
list_item_2 = ListItem(List=explode_4.Segments, Index=0, Wrap=True)  # -> Item, Item1, Item2, Item3
list_item_3 = ListItem(List=arc_3pt.Arc, Index=0, Wrap=True)  # -> Item, Item1, Item2, Item3
list_item_4 = ListItem(List=explode_4.Segments, Index=0, Wrap=True)  # -> Item, Item1, Item2, Item3
list_item_5 = ListItem(List=arc_3pt.Arc, Index=0, Wrap=True)  # -> Item, Item1, Item2, Item3
list_item_6 = ListItem(List=explode_4.Segments, Index=0, Wrap=True)  # -> Item, Item1, Item2, Item3
list_item_7 = ListItem(List=arc_3pt.Arc, Index=0, Wrap=True)  # -> Item, Item1, Item2, Item3
list_item_8 = ListItem(List=explode_4.Segments, Index=0, Wrap=True)  # -> Item, Item1, Item2, Item3
# Drum Columns:
# The columns have the monumental proportions of the Doric Order.
# The drums of white Pentelic marble were carved
# in situ to their fluted profiles,
# which deepen towards the top
# to emphasis the shadow lines and
# volumetric composition.
# 
# Entasis:
# The tapering columns are swotllen in section about two-fifths of the way up,
# to correct the illusion of the concave profile
# that a straight-sided shaft would produce.
# 
# End Columns:
# The end columns have a closer spacing and thicker diameter than the main columns
# and incline diagonally towards the center of the temple
# to counteract their appearance of outward inclination.
# 
# Other Outer Columns:
# The other columns are inclined inward.
sweep2 = Sweep2(Rail1=list_item.Item, Rail2=list_item.Item1, Sections=list_item_2.Item, SameHeight=False)
sweep2_2 = Sweep2(Rail1=list_item_3.Item, Rail2=list_item_3.Item2, Sections=list_item_4.Item1, SameHeight=False)
sweep2_3 = Sweep2(Rail1=list_item_5.Item, Rail2=list_item_5.Item3, Sections=list_item_6.Item3, SameHeight=False)
sweep2_4 = Sweep2(Rail1=list_item_7.Item1, Rail2=list_item_7.Item3, Sections=list_item_8.Item2, SameHeight=False)

scale_nu_3 = ScaleNU(Geometry=move_2.Geometry, Plane=plane_2, ScaleX=range, ScaleY=range_2, ScaleZ=1)  # -> Geometry, Transform
move_3 = Move(Geometry=scale_nu_3.Geometry, Motion=unit_z)  # -> Geometry, Transform
cull_index_3 = CullIndex(List=scale_nu_3.Geometry, Indices="-1", Wrap=True)
cull_index_4 = CullIndex(List=move_3.Geometry, Indices="0", Wrap=True)
explode_5 = Explode(Curve=cull_index_3, Recursive=True)  # -> graft(Segments), Vertices
explode_6 = Explode(Curve=cull_index_4, Recursive=True)  # -> graft(Segments), Vertices
loft_2 = Loft(
    Curves=[explode_5.Segments, explode_6.Segments],
    Options={Adjust=False, Closed=False, LoftEnds=0, LoftSimp=0, LoftType=0, Rebuild=10, Refit=0.01})
join_curves_3 = JoinCurves(Curves=flatten(explode_6.Segments), Preserve=False)
scale_nu_4 = ScaleNU(Geometry=join_curves_3, Plane=plane_2, ScaleX=multiplication, ScaleY=multiplication_2, ScaleZ=1)  # -> Geometry, Transform
move_4 = Move(Geometry=scale_nu_4.Geometry, Motion=negative_2)  # -> Geometry, Transform
explode_7 = Explode(Curve=move_4.Geometry, Recursive=True)  # -> Segments, Vertices
explode_8 = Explode(Curve=join_curves_3, Recursive=True)  # -> Segments, Vertices
line_2 = Line(StartPoint=explode_8.Vertices, EndPoint=explode_7.Vertices)
curve_middle_2 = CurveMiddle(Curve=line_2)
scale_2 = Scale(Geometry=curve_middle_2, Center=Point(0, 0, 0), Factor=Slider(1.003576, range=1.000999..1.011))  # -> Geometry, Transform
arc_3pt_2 = Arc3Pt(PointA=explode_8.Vertices, PointB=scale_2.Geometry, PointC=explode_7.Vertices)  # -> Arc, Plane, Radius
list_item_9 = ListItem(List=arc_3pt_2.Arc, Index=0, Wrap=True)  # -> Item, Item1, Item2, Item3
list_item_10 = ListItem(List=explode_8.Segments, Index=0, Wrap=True)  # -> Item, Item1, Item2, Item3
list_item_11 = ListItem(List=arc_3pt_2.Arc, Index=0, Wrap=True)  # -> Item, Item1, Item2, Item3
list_item_12 = ListItem(List=explode_8.Segments, Index=0, Wrap=True)  # -> Item, Item1, Item2, Item3
list_item_13 = ListItem(List=arc_3pt_2.Arc, Index=0, Wrap=True)  # -> Item, Item1, Item2, Item3
list_item_14 = ListItem(List=explode_8.Segments, Index=0, Wrap=True)  # -> Item, Item1, Item2, Item3
list_item_15 = ListItem(List=arc_3pt_2.Arc, Index=0, Wrap=True)  # -> Item, Item1, Item2, Item3
list_item_16 = ListItem(List=explode_8.Segments, Index=0, Wrap=True)  # -> Item, Item1, Item2, Item3
sweep2_5 = Sweep2(Rail1=list_item_9.Item, Rail2=list_item_9.Item1, Sections=list_item_10.Item, SameHeight=False)
sweep2_6 = Sweep2(Rail1=list_item_11.Item, Rail2=list_item_11.Item2, Sections=list_item_12.Item1, SameHeight=False)
sweep2_7 = Sweep2(Rail1=list_item_13.Item, Rail2=list_item_13.Item3, Sections=list_item_14.Item3, SameHeight=False)
sweep2_8 = Sweep2(Rail1=list_item_15.Item1, Rail2=list_item_15.Item3, Sections=list_item_16.Item2, SameHeight=False)

scale_nu_5 = ScaleNU(Geometry=move_4.Geometry, Plane=plane_2, ScaleX=range, ScaleY=range_2, ScaleZ=1)  # -> Geometry, Transform
move_5 = Move(Geometry=scale_nu_5.Geometry, Motion=unit_z)  # -> Geometry, Transform
cull_index_5 = CullIndex(List=scale_nu_5.Geometry, Indices="-1", Wrap=True)
cull_index_6 = CullIndex(List=move_5.Geometry, Indices="0", Wrap=True)
explode_9 = Explode(Curve=cull_index_5, Recursive=True)  # -> graft(Segments), Vertices
explode_10 = Explode(Curve=cull_index_6, Recursive=True)  # -> graft(Segments), Vertices
loft_3 = Loft(
    Curves=[explode_9.Segments, explode_10.Segments],
    Options={Adjust=False, Closed=False, LoftEnds=0, LoftSimp=0, LoftType=0, Rebuild=10, Refit=0.01})
join_curves_4 = JoinCurves(Curves=flatten(explode_10.Segments), Preserve=False)
scale_nu_6 = ScaleNU(Geometry=join_curves_4, Plane=plane_2, ScaleX=multiplication, ScaleY=multiplication_2, ScaleZ=1)  # -> Geometry, Transform
move_6 = Move(Geometry=scale_nu_6.Geometry, Motion=negative_2)  # -> Geometry, Transform
explode_11 = Explode(Curve=move_6.Geometry, Recursive=True)  # -> Segments, Vertices
explode_12 = Explode(Curve=join_curves_4, Recursive=True)  # -> Segments, Vertices
line_3 = Line(StartPoint=explode_12.Vertices, EndPoint=explode_11.Vertices)
curve_middle_3 = CurveMiddle(Curve=line_3)
scale_3 = Scale(Geometry=curve_middle_3, Center=Point(0, 0, 0), Factor=Slider(1.003576, range=1.000999..1.011))  # -> Geometry, Transform
arc_3pt_3 = Arc3Pt(PointA=explode_12.Vertices, PointB=scale_3.Geometry, PointC=explode_11.Vertices)  # -> Arc, Plane, Radius
list_item_17 = ListItem(List=arc_3pt_3.Arc, Index=0, Wrap=True)  # -> Item, Item1, Item2, Item3
list_item_18 = ListItem(List=explode_12.Segments, Index=0, Wrap=True)  # -> Item, Item1, Item2, Item3
list_item_19 = ListItem(List=arc_3pt_3.Arc, Index=0, Wrap=True)  # -> Item, Item1, Item2, Item3
list_item_20 = ListItem(List=explode_12.Segments, Index=0, Wrap=True)  # -> Item, Item1, Item2, Item3
list_item_21 = ListItem(List=arc_3pt_3.Arc, Index=0, Wrap=True)  # -> Item, Item1, Item2, Item3
list_item_22 = ListItem(List=explode_12.Segments, Index=0, Wrap=True)  # -> Item, Item1, Item2, Item3
list_item_23 = ListItem(List=arc_3pt_3.Arc, Index=0, Wrap=True)  # -> Item, Item1, Item2, Item3
list_item_24 = ListItem(List=explode_12.Segments, Index=0, Wrap=True)  # -> Item, Item1, Item2, Item3
sweep2_9 = Sweep2(Rail1=list_item_17.Item, Rail2=list_item_17.Item1, Sections=list_item_18.Item, SameHeight=False)
sweep2_10 = Sweep2(Rail1=list_item_19.Item, Rail2=list_item_19.Item2, Sections=list_item_20.Item1, SameHeight=False)
sweep2_11 = Sweep2(Rail1=list_item_21.Item, Rail2=list_item_21.Item3, Sections=list_item_22.Item3, SameHeight=False)
sweep2_12 = Sweep2(Rail1=list_item_23.Item1, Rail2=list_item_23.Item3, Sections=list_item_24.Item2, SameHeight=False)

scale_nu_7 = ScaleNU(Geometry=move_6.Geometry, Plane=plane_2, ScaleX=range, ScaleY=range_2, ScaleZ=1)  # -> Geometry, Transform
move_7 = Move(Geometry=scale_nu_7.Geometry, Motion=unit_z)  # -> Geometry, Transform
cull_index_7 = CullIndex(List=scale_nu_7.Geometry, Indices="-1", Wrap=True)
cull_index_8 = CullIndex(List=move_7.Geometry, Indices="0", Wrap=True)
explode_13 = Explode(Curve=cull_index_7, Recursive=True)  # -> graft(Segments), Vertices
explode_14 = Explode(Curve=cull_index_8, Recursive=True)  # -> graft(Segments), Vertices
loft_4 = Loft(
    Curves=[explode_13.Segments, explode_14.Segments],
    Options={Adjust=False, Closed=False, LoftEnds=0, LoftSimp=0, LoftType=0, Rebuild=10, Refit=0.01})
join_curves_5 = JoinCurves(Curves=flatten(explode_14.Segments), Preserve=False)
scale_nu_8 = ScaleNU(Geometry=join_curves_5, Plane=plane_2, ScaleX=multiplication, ScaleY=multiplication_2, ScaleZ=1)  # -> Geometry, Transform
move_8 = Move(Geometry=scale_nu_8.Geometry, Motion=negative_2)  # -> Geometry, Transform
explode_15 = Explode(Curve=move_8.Geometry, Recursive=True)  # -> Segments, Vertices
explode_16 = Explode(Curve=join_curves_5, Recursive=True)  # -> Segments, Vertices
line_4 = Line(StartPoint=explode_16.Vertices, EndPoint=explode_15.Vertices)
curve_middle_4 = CurveMiddle(Curve=line_4)
scale_4 = Scale(Geometry=curve_middle_4, Center=Point(0, 0, 0), Factor=Slider(1.003576, range=1.000999..1.011))  # -> Geometry, Transform
arc_3pt_4 = Arc3Pt(PointA=explode_16.Vertices, PointB=scale_4.Geometry, PointC=explode_15.Vertices)  # -> Arc, Plane, Radius
list_item_25 = ListItem(List=arc_3pt_4.Arc, Index=0, Wrap=True)  # -> Item, Item1, Item2, Item3
list_item_26 = ListItem(List=explode_16.Segments, Index=0, Wrap=True)  # -> Item, Item1, Item2, Item3
list_item_27 = ListItem(List=arc_3pt_4.Arc, Index=0, Wrap=True)  # -> Item, Item1, Item2, Item3
list_item_28 = ListItem(List=explode_16.Segments, Index=0, Wrap=True)  # -> Item, Item1, Item2, Item3
list_item_29 = ListItem(List=arc_3pt_4.Arc, Index=0, Wrap=True)  # -> Item, Item1, Item2, Item3
list_item_30 = ListItem(List=explode_16.Segments, Index=0, Wrap=True)  # -> Item, Item1, Item2, Item3
list_item_31 = ListItem(List=arc_3pt_4.Arc, Index=0, Wrap=True)  # -> Item, Item1, Item2, Item3
list_item_32 = ListItem(List=explode_16.Segments, Index=0, Wrap=True)  # -> Item, Item1, Item2, Item3
sweep2_13 = Sweep2(Rail1=list_item_25.Item, Rail2=list_item_25.Item1, Sections=list_item_26.Item, SameHeight=False)
sweep2_14 = Sweep2(Rail1=list_item_27.Item, Rail2=list_item_27.Item2, Sections=list_item_28.Item1, SameHeight=False)
sweep2_15 = Sweep2(Rail1=list_item_29.Item, Rail2=list_item_29.Item3, Sections=list_item_30.Item3, SameHeight=False)
sweep2_16 = Sweep2(Rail1=list_item_31.Item1, Rail2=list_item_31.Item3, Sections=list_item_32.Item2, SameHeight=False)

scale_nu_9 = ScaleNU(Geometry=move_8.Geometry, Plane=plane_2, ScaleX=range, ScaleY=range_2, ScaleZ=1)  # -> Geometry, Transform
move_9 = Move(Geometry=scale_nu_9.Geometry, Motion=unit_z)  # -> Geometry, Transform
cull_index_9 = CullIndex(List=scale_nu_9.Geometry, Indices="-1", Wrap=True)
cull_index_10 = CullIndex(List=move_9.Geometry, Indices="0", Wrap=True)
explode_17 = Explode(Curve=cull_index_9, Recursive=True)  # -> graft(Segments), Vertices
explode_18 = Explode(Curve=cull_index_10, Recursive=True)  # -> graft(Segments), Vertices
loft_5 = Loft(
    Curves=[explode_17.Segments, explode_18.Segments],
    Options={Adjust=False, Closed=False, LoftEnds=0, LoftSimp=0, LoftType=0, Rebuild=10, Refit=0.01})
join_curves_6 = JoinCurves(Curves=flatten(explode_18.Segments), Preserve=False)
scale_nu_10 = ScaleNU(Geometry=join_curves_6, Plane=plane_2, ScaleX=multiplication, ScaleY=multiplication_2, ScaleZ=1)  # -> Geometry, Transform
move_10 = Move(Geometry=scale_nu_10.Geometry, Motion=negative_2)  # -> Geometry, Transform
explode_19 = Explode(Curve=move_10.Geometry, Recursive=True)  # -> Segments, Vertices
explode_20 = Explode(Curve=join_curves_6, Recursive=True)  # -> Segments, Vertices
line_5 = Line(StartPoint=explode_20.Vertices, EndPoint=explode_19.Vertices)
curve_middle_5 = CurveMiddle(Curve=line_5)
scale_5 = Scale(Geometry=curve_middle_5, Center=Point(0, 0, 0), Factor=Slider(1.003576, range=1.000999..1.011))  # -> Geometry, Transform
arc_3pt_5 = Arc3Pt(PointA=explode_20.Vertices, PointB=scale_5.Geometry, PointC=explode_19.Vertices)  # -> Arc, Plane, Radius
list_item_33 = ListItem(List=arc_3pt_5.Arc, Index=0, Wrap=True)  # -> Item, Item1, Item2, Item3
list_item_34 = ListItem(List=explode_20.Segments, Index=0, Wrap=True)  # -> Item, Item1, Item2, Item3
list_item_35 = ListItem(List=arc_3pt_5.Arc, Index=0, Wrap=True)  # -> Item, Item1, Item2, Item3
list_item_36 = ListItem(List=explode_20.Segments, Index=0, Wrap=True)  # -> Item, Item1, Item2, Item3
list_item_37 = ListItem(List=arc_3pt_5.Arc, Index=0, Wrap=True)  # -> Item, Item1, Item2, Item3
list_item_38 = ListItem(List=explode_20.Segments, Index=0, Wrap=True)  # -> Item, Item1, Item2, Item3
list_item_39 = ListItem(List=arc_3pt_5.Arc, Index=0, Wrap=True)  # -> Item, Item1, Item2, Item3
list_item_40 = ListItem(List=explode_20.Segments, Index=0, Wrap=True)  # -> Item, Item1, Item2, Item3
sweep2_17 = Sweep2(Rail1=list_item_33.Item, Rail2=list_item_33.Item1, Sections=list_item_34.Item, SameHeight=False)
sweep2_18 = Sweep2(Rail1=list_item_35.Item, Rail2=list_item_35.Item2, Sections=list_item_36.Item1, SameHeight=False)
sweep2_19 = Sweep2(Rail1=list_item_37.Item, Rail2=list_item_37.Item3, Sections=list_item_38.Item3, SameHeight=False)
sweep2_20 = Sweep2(Rail1=list_item_39.Item1, Rail2=list_item_39.Item3, Sections=list_item_40.Item2, SameHeight=False)

multiplication_3 = Multiplication(A="1", B="3.84")
multiplication_4 = Multiplication(A="1", B="4.19")
list_item_41 = ListItem(List=explode.Vertices, Index="1", Wrap=True)
radius = Radius(1)
multiplication_5 = Multiplication(A=radius, B=Slider(0.121, range=0..0.15))
rectangular = Rectangular(Plane=list_item_41, SizeX=multiplication_3, SizeY=multiplication_4, ExtentX="18", ExtentY="9")  # -> Cells, Points
circle = Circle(Plane=PlaneXY(0, 0, 0), Radius=radius)
point_3 = Point(simplify(rectangular.Points))
divide_curve = DivideCurve(Curve=circle, Count=Slider(18, range=0..100), Kinks=False)  # -> Points, Tangents, Parameters
circle_2 = Circle(Plane=divide_curve.Points, Radius=multiplication_5)
split_tree = SplitTree(Data=point_3, Masks=flatten(["{2to16}[1,8]", "{1,17}[2to7]"]))  # -> Positive, Negative
split_tree_2 = SplitTree(Data=point_3, Masks=flatten("{1,17}[1,8]"))  # -> Positive, Negative
trim_with_regions = TrimWithRegions(Curve=circle, Regions=flatten(circle_2))  # -> Inside, Outside
trim_with_regions_2 = TrimWithRegions(Curve=flatten(circle_2), Regions=circle)  # -> Inside, Outside
range_4 = Range(Domain=Slider(18, range=0..18), Steps="7")
construct_domain_4 = ConstructDomain(DomainStart="1", DomainEnd=Slider(0.66, range=0..1))
param_viewer = ParamViewer(point_3)
clean_tree = CleanTree(RemoveNulls=True, RemoveInvalid=True, RemoveEmpty=False, Tree=split_tree_2.Positive)
clean_tree_2 = CleanTree(RemoveNulls=True, RemoveInvalid=True, RemoveEmpty=False, Tree=split_tree.Positive)
curve_3 = Curve(trim_with_regions.Outside)
curve_4 = Curve(trim_with_regions_2.Inside)
join_curves_7 = JoinCurves(Curves=flatten([curve_3, curve_4]), Preserve=False)
unit_z_3 = UnitZ(Factor=range_4)
range_5 = Range(Domain=construct_domain_4, Steps="7")
point_4 = Point(clean_tree)
point_5 = Point(clean_tree_2)

# ---- group: Point Visualization Tool
mesh_sphere = MeshSphere(Base=point_4, Radius=1, UCount=10, VCount=20)

# ----
move_11 = Move(Geometry=join_curves_7, Motion=unit_z_3)  # -> Geometry, Transform
graph_mapper = GraphMapper(range_5, x0=0, x1=1, y0=0, y1=1, container_name="Sine", Equation_px=[0.2936233282, 1], Equation_py=[0.3069564104, 1])
area_2 = Area(Geometry=move_11.Geometry)  # -> Area, Centroid
scale_6 = Scale(Geometry=move_11.Geometry, Center=area_2.Centroid, Factor=graph_mapper)  # -> Geometry, Transform
loft_6 = Loft(
    Curves=scale_6.Geometry,
    Options={Adjust=False, Closed=False, LoftEnds=0, LoftSimp=0, LoftType=0, Rebuild=10, Refit=0.01})
