# Grasshopper definition ARCH_TheParthenon_Tutorial_002.gh (Grasshopper 1.0.7)

# ---- group: Step Parameters
number_slider = Slider(0.05, range=0..1)
number_slider_2 = Slider(1.0452, range=1..1.1001)
number_slider_3 = Slider(1.0863, range=1..1.1001)
number_slider_4 = Slider(1.008, range=1..1.01)
number_slider_5 = Slider(1.002, range=1..1.01)

# ----
negative = Negative(Value=number_slider)
# the Parthenon
split_tree = SplitTree()  # -> Positive, Negative

# ---- group: floorRef
# Steps:
# The steps have a curved profile,
# rising towards the centre.
# Teh treads are set slight upward tilt.
# the devices fo perspective correction produce a
# complex geometry for construction.
brep = Brep(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)

# ----
construct_domain = ConstructDomain(DomainStart="0", DomainEnd=negative)
construct_domain_2 = ConstructDomain(DomainStart="1", DomainEnd=number_slider_2)
construct_domain_3 = ConstructDomain(DomainStart="1", DomainEnd=number_slider_3)

# ----
# Imported, scaled, and centre reference  image.
# Set to layer, made transparent, and locked.
area = Area(Geometry=brep)  # -> Area, Centroid
deconstruct_brep = DeconstructBrep(Brep=brep)  # -> Faces, Edges, Vertices
curve = Curve(deconstruct_brep.Edges)
brep_2 = Brep(deconstruct_brep.Faces)
point = Point(area.Centroid)
point_2 = Point(deconstruct_brep.Vertices)
deconstruct = Deconstruct(Point=point)  # -> XComponent, YComponent, ZComponent
construct_point = ConstructPoint(XCoordinate=deconstruct.XComponent, YCoordinate=deconstruct.YComponent, ZCoordinate=deconstruct.ZComponent)
data = Data(deconstruct.XComponent)
panel = Panel(data)
construct_plane = ConstructPlane(Origin=construct_point, XAxis=Vector(1, 0, 0), YAxis=Vector(0, 1, 0))
plane = Plane(construct_plane)

point_3 = Point(point)
curve_2 = Curve(curve)
plane_2 = Plane(plane)
join_curves = JoinCurves(Curves=curve_2, Preserve=False)
range = Range(Domain=construct_domain, Steps="1")
range_2 = Range(Domain=construct_domain_2, Steps="1")
range_3 = Range(Domain=construct_domain_3, Steps="1")
unit_z = UnitZ(Factor=range)

# ---- group: visualizationTool
mesh_sphere = MeshSphere(Base=point_2, Radius=0.4, UCount=10, VCount=20)

# ----
number_slider_6 = Slider(0.56, range=0..1)

number_slider_7 = Slider(0.14, range=0..1)  # disabled
number_slider_8 = Slider(0.56, range=0..1)  # disabled
point_4 = Point(point)  # disabled
number_slider_9 = Slider(18, range=0..100)  # disabled
multiplication = Multiplication(A=number_slider_8, B=number_slider_7)  # disabled
circle = Circle(Plane=point_4, Radius=number_slider_8)  # disabled
divide_curve = DivideCurve(Curve=circle, Count=number_slider_9, Kinks=False)  # -> Points, Tangents, Parameters; disabled
number_slider_10 = Slider(6.788, range=0..10)  # disabled
panel_2 = Panel("7")  # disabled
range_4 = Range(Domain=number_slider_10, Steps=panel_2)  # disabled
number_slider_11 = Slider(0.61, range=0..1)  # disabled
unit_z_2 = UnitZ(Factor=range_4)  # disabled
panel_3 = Panel("1")  # disabled
construct_domain_4 = ConstructDomain(DomainStart=panel_3, DomainEnd=number_slider_11)  # disabled
move = Move(Geometry=circle, Motion=unit_z_2)  # -> Geometry, Transform; disabled
move_2 = Move(Geometry=graft(divide_curve.Points), Motion=unit_z_2)  # -> Geometry, Transform; disabled
gene_pool = GenePool(Decimals=3, Maximum=0.07, Minimum=0, Value=[0.032, 0.038, 0.046, 0.054, 0.059, 0.065, 0.07])  # disabled
gene_pool_2 = GenePool(Decimals=2, Maximum=1, Minimum=0, Value=[0, 0.12, 0.23, 0.43, 0.65, 0.81, 1])  # disabled
interpolate = Interpolate(Vertices=move_2.Geometry, Degree=3, Periodic=False, KnotStyle=1)  # -> Curve, Length, Domain; disabled
pipe_variable = PipeVariable(Curve=reparameterize(interpolate.Curve), Parameters=gene_pool_2, Radii=gene_pool, Caps=0)  # disabled
loft = Loft(Curves=move.Geometry, Options={Adjust=False, Closed=False, LoftEnds=0, LoftSimp=0, LoftType=0, Rebuild=10, Refit=0.01})  # disabled
number_slider_12 = Slider(0, range=0..1)  # disabled
number_slider_13 = Slider(1, range=0..1)  # disabled
number_slider_14 = Slider(0.985, range=0..1)  # disabled
cap_holes = CapHoles(Brep=loft)  # disabled
cap_holes_2 = CapHoles(Brep=pipe_variable)  # disabled
volume = Volume(Geometry=cap_holes)  # -> Volume, Centroid; disabled
scale = Scale(Geometry=cap_holes, Center=volume.Centroid, Factor=number_slider_14)  # -> Geometry, Transform; disabled
list_item = ListItem(List=flatten(cap_holes_2), Index=number_slider_12, Wrap=True)  # disabled
list_item_2 = ListItem(List=flatten(cap_holes_2), Index=number_slider_13, Wrap=True)  # disabled
solid_difference = SolidDifference(BrepsA=scale.Geometry, BrepsB=list_item)  # disabled
solid_difference_2 = SolidDifference(BrepsA=solid_difference, BrepsB=list_item_2)  # disabled

# ----
# Drum Column:
# The columns have the monumental proportions fo the Doric Order.
# The drums of white marble were carved
# in situ to their fluted profiles,
# which deepen towards the top
# to emphasis the shadow lines and
# volumetric compositon.
# 
# Entasis:
# The tapering columns are swollen in sections about two-fifth of the way up,
# to correct the illusion of th concave profile
# that a straight-sided shaft would produce.
# 
# End Columns:
# The end columns a have a closer spacing and thicker diameter than the main columns
# and incline diagonally towards the centre of the temple
# to counteract their appearance of outward inclination.
# 
# Other Columns:
# The other columns are inclined inward.
point_5 = Point(point)
multiplication_2 = Multiplication(A=number_slider_6, B=Slider(0.14, range=0..1))
circle_2 = Circle(Plane=point_5, Radius=number_slider_6)
divide_curve_2 = DivideCurve(Curve=circle_2, Count=Slider(18, range=0..100), Kinks=False)  # -> Points, Tangents, Parameters
circle_3 = Circle(Plane=divide_curve_2.Points, Radius=multiplication_2)

circle_4 = Circle(Plane=divide_curve.Points, Radius=multiplication)  # disabled
trim_with_regions = TrimWithRegions(Curve=circle, Regions=circle_4)  # -> Inside, Outside; disabled
trim_with_regions_2 = TrimWithRegions(Curve=circle_4, Regions=circle)  # -> Inside, Outside; disabled
curve_3 = Curve(trim_with_regions.Outside)  # disabled
curve_4 = Curve(trim_with_regions_2.Inside)  # disabled
join_curves_2 = JoinCurves(Curves=flatten([curve_3, curve_4]), Preserve=False)  # disabled

trim_with_regions_3 = TrimWithRegions(Curve=circle_2, Regions=circle_3)  # -> Inside, Outside
trim_with_regions_4 = TrimWithRegions(Curve=circle_3, Regions=circle_2)  # -> Inside, Outside
range_5 = Range(Domain=Slider(6.788, range=0..10), Steps="7")
curve_5 = Curve(trim_with_regions_3.Outside)
curve_6 = Curve(trim_with_regions_4.Inside)
join_curves_3 = JoinCurves(Curves=flatten([curve_5, curve_6]), Preserve=False)
unit_z_3 = UnitZ(Factor=range_5)
construct_domain_5 = ConstructDomain(DomainStart="1", DomainEnd=Slider(0.61, range=0..1))
move_3 = Move(Geometry=join_curves_3, Motion=unit_z_3)  # -> Geometry, Transform
split_tree_2 = SplitTree(Masks=flatten("{1;0;*}[2to4]"))  # -> Positive, Negative
area_2 = Area(Geometry=move_3.Geometry)  # -> Area, Centroid
range_6 = Range(Domain=construct_domain_5, Steps="7")

area_3 = Area(Geometry=move.Geometry)  # -> Area, Centroid; disabled
range_7 = Range(Domain=construct_domain_4, Steps=panel_2)  # disabled
graph_mapper = GraphMapper(range_7, x0=0, x1=1, y0=0, y1=1, container_name="Sine", Equation_px=[0, 0.9146978259], Equation_py=[0, 1])  # disabled
scale_2 = Scale(Geometry=move.Geometry, Center=area_3.Centroid, Factor=graph_mapper)  # -> Geometry, Transform; disabled

graph_mapper_2 = GraphMapper(range_6, x0=0, x1=1, y0=0, y1=1, container_name="Sine", Equation_px=[0, 0.9146978259], Equation_py=[0, 1])
scale_3 = Scale(Geometry=move_3.Geometry, Center=area_2.Centroid, Factor=graph_mapper_2)  # -> Geometry, Transform
loft_2 = Loft(
    Curves=scale_3.Geometry,
    Options={Adjust=False, Closed=False, LoftEnds=0, LoftSimp=0, LoftType=0, Rebuild=10, Refit=0.01})
cap_holes_3 = CapHoles(Brep=loft_2)

scale_nu = ScaleNU(Geometry=join_curves, Plane=plane_2, ScaleX=range_2, ScaleY=range_3, ScaleZ=1)  # -> Geometry, Transform
move_4 = Move(Geometry=scale_nu.Geometry, Motion=unit_z)  # -> Geometry, Transform
cull_index = CullIndex(List=scale_nu.Geometry, Indices="-1", Wrap=True)
cull_index_2 = CullIndex(List=move_4.Geometry, Indices="0", Wrap=True)
multiplication_3 = Multiplication(A="1", B=number_slider_4)
multiplication_4 = Multiplication(A="1", B=number_slider_4)
explode = Explode(Curve=cull_index, Recursive=True)  # -> graft(Segments), Vertices
explode_2 = Explode(Curve=cull_index_2, Recursive=True)  # -> graft(Segments), Vertices
unit_z_4 = UnitZ(Factor=multiplication_4)
join_curves_4 = JoinCurves(Curves=flatten(explode_2.Segments), Preserve=False)
negative_2 = Negative(Value=unit_z_4)
merge = Merge(Data1=explode.Segments, Data2=explode_2.Segments)
scale_nu_2 = ScaleNU(Geometry=join_curves_4, Plane=plane_2, ScaleX=multiplication_4, ScaleY=multiplication_3, ScaleZ=1)  # -> Geometry, Transform
move_5 = Move(Geometry=scale_nu_2.Geometry, Motion=negative_2)  # -> Geometry, Transform
explode_3 = Explode(Curve=join_curves_4, Recursive=True)  # -> Segments, Vertices
explode_4 = Explode(Curve=move_5.Geometry, Recursive=True)  # -> Segments, Vertices
line = Line(StartPoint=explode_3.Vertices, EndPoint=explode_4.Vertices)
point_on_curve = PointOnCurve(line, parameter=0.523)
end_points = EndPoints(Curve=line)  # -> Start, End
list_item_3 = ListItem(List=explode_3.Segments, Index=0, Wrap=True)  # -> Item, Item1, Item2, Item3
list_item_4 = ListItem(List=explode_3.Segments, Index=0, Wrap=True)  # -> Item, Item1, Item2, Item3
list_item_5 = ListItem(List=explode_3.Segments, Index=0, Wrap=True)  # -> Item, Item1, Item2, Item3
list_item_6 = ListItem(List=explode_3.Segments, Index=0, Wrap=True)  # -> Item, Item1, Item2, Item3
loft_3 = Loft(Curves=merge, Options={Adjust=False, Closed=False, LoftEnds=0, LoftSimp=0, LoftType=0, Rebuild=10, Refit=0.01})

scale_nu_3 = ScaleNU(Geometry=move_5.Geometry, Plane=plane_2, ScaleX=range_2, ScaleY=range_3, ScaleZ=1)  # -> Geometry, Transform
move_6 = Move(Geometry=scale_nu_3.Geometry, Motion=unit_z)  # -> Geometry, Transform
cull_index_3 = CullIndex(List=scale_nu_3.Geometry, Indices="-1", Wrap=True)
cull_index_4 = CullIndex(List=move_6.Geometry, Indices="0", Wrap=True)
multiplication_5 = Multiplication(A="1", B=number_slider_4)
multiplication_6 = Multiplication(A="1", B=number_slider_4)
explode_5 = Explode(Curve=cull_index_3, Recursive=True)  # -> graft(Segments), Vertices
explode_6 = Explode(Curve=cull_index_4, Recursive=True)  # -> graft(Segments), Vertices
unit_z_5 = UnitZ(Factor=multiplication_6)
join_curves_5 = JoinCurves(Curves=flatten(explode_6.Segments), Preserve=False)
negative_3 = Negative(Value=unit_z_5)
merge_2 = Merge(Data1=explode_5.Segments, Data2=explode_6.Segments)
scale_nu_4 = ScaleNU(Geometry=join_curves_5, Plane=plane_2, ScaleX=multiplication_6, ScaleY=multiplication_5, ScaleZ=1)  # -> Geometry, Transform
move_7 = Move(Geometry=scale_nu_4.Geometry, Motion=negative_3)  # -> Geometry, Transform
explode_7 = Explode(Curve=join_curves_5, Recursive=True)  # -> Segments, Vertices
explode_8 = Explode(Curve=move_7.Geometry, Recursive=True)  # -> Segments, Vertices
line_2 = Line(StartPoint=explode_7.Vertices, EndPoint=explode_8.Vertices)
point_on_curve_2 = PointOnCurve(line_2, parameter=0.531)
end_points_2 = EndPoints(Curve=line_2)  # -> Start, End
scale_4 = Scale(Geometry=point_on_curve_2, Center=point_3, Factor=number_slider_5)  # -> Geometry, Transform
arc_3pt = Arc3Pt(PointA=end_points_2.Start, PointB=scale_4.Geometry, PointC=end_points_2.End)  # -> Arc, Plane, Radius
list_item_7 = ListItem(List=arc_3pt.Arc, Index=0, Wrap=True)  # -> Item, Item1, Item2, Item3
list_item_8 = ListItem(List=arc_3pt.Arc, Index=0, Wrap=True)  # -> Item, Item1, Item2, Item3
list_item_9 = ListItem(List=explode_7.Segments, Index=0, Wrap=True)  # -> Item, Item1, Item2, Item3
list_item_10 = ListItem(List=explode_7.Segments, Index=0, Wrap=True)  # -> Item, Item1, Item2, Item3
list_item_11 = ListItem(List=arc_3pt.Arc, Index=0, Wrap=True)  # -> Item, Item1, Item2, Item3
list_item_12 = ListItem(List=arc_3pt.Arc, Index=0, Wrap=True)  # -> Item, Item1, Item2, Item3
list_item_13 = ListItem(List=explode_7.Segments, Index=0, Wrap=True)  # -> Item, Item1, Item2, Item3
list_item_14 = ListItem(List=explode_7.Segments, Index=0, Wrap=True)  # -> Item, Item1, Item2, Item3
sweep2 = Sweep2(Rail1=list_item_8.Item, Rail2=list_item_8.Item2, Sections=list_item_10.Item1, SameHeight=False)
sweep2_2 = Sweep2(Rail1=list_item_12.Item1, Rail2=list_item_12.Item3, Sections=list_item_14.Item2, SameHeight=False)
loft_4 = Loft(Curves=merge_2, Options={Adjust=False, Closed=False, LoftEnds=0, LoftSimp=0, LoftType=0, Rebuild=10, Refit=0.01})
sweep2_3 = Sweep2(Rail1=list_item_7.Item, Rail2=list_item_7.Item1, Sections=list_item_9.Item, SameHeight=False)
sweep2_4 = Sweep2(Rail1=list_item_11.Item, Rail2=list_item_11.Item3, Sections=list_item_13.Item3, SameHeight=False)

scale_nu_5 = ScaleNU(Geometry=move_7.Geometry, Plane=plane_2, ScaleX=range_2, ScaleY=range_3, ScaleZ=1)  # -> Geometry, Transform
move_8 = Move(Geometry=scale_nu_5.Geometry, Motion=unit_z)  # -> Geometry, Transform
cull_index_5 = CullIndex(List=scale_nu_5.Geometry, Indices="-1", Wrap=True)
cull_index_6 = CullIndex(List=move_8.Geometry, Indices="0", Wrap=True)
multiplication_7 = Multiplication(A="1", B=number_slider_4)
multiplication_8 = Multiplication(A="1", B=number_slider_4)
explode_9 = Explode(Curve=cull_index_5, Recursive=True)  # -> graft(Segments), Vertices
explode_10 = Explode(Curve=cull_index_6, Recursive=True)  # -> graft(Segments), Vertices
unit_z_6 = UnitZ(Factor=multiplication_8)
join_curves_6 = JoinCurves(Curves=flatten(explode_10.Segments), Preserve=False)
negative_4 = Negative(Value=unit_z_6)
merge_3 = Merge(Data1=explode_9.Segments, Data2=explode_10.Segments)
scale_nu_6 = ScaleNU(Geometry=join_curves_6, Plane=plane_2, ScaleX=multiplication_8, ScaleY=multiplication_7, ScaleZ=1)  # -> Geometry, Transform
move_9 = Move(Geometry=scale_nu_6.Geometry, Motion=negative_4)  # -> Geometry, Transform
explode_11 = Explode(Curve=join_curves_6, Recursive=True)  # -> Segments, Vertices
explode_12 = Explode(Curve=move_9.Geometry, Recursive=True)  # -> Segments, Vertices
line_3 = Line(StartPoint=explode_11.Vertices, EndPoint=explode_12.Vertices)
point_on_curve_3 = PointOnCurve(line_3, parameter=0.531)
end_points_3 = EndPoints(Curve=line_3)  # -> Start, End
scale_5 = Scale(Geometry=point_on_curve_3, Center=point_3, Factor=number_slider_5)  # -> Geometry, Transform
arc_3pt_2 = Arc3Pt(PointA=end_points_3.Start, PointB=scale_5.Geometry, PointC=end_points_3.End)  # -> Arc, Plane, Radius
list_item_15 = ListItem(List=arc_3pt_2.Arc, Index=0, Wrap=True)  # -> Item, Item1, Item2, Item3
list_item_16 = ListItem(List=arc_3pt_2.Arc, Index=0, Wrap=True)  # -> Item, Item1, Item2, Item3
list_item_17 = ListItem(List=explode_11.Segments, Index=0, Wrap=True)  # -> Item, Item1, Item2, Item3
list_item_18 = ListItem(List=explode_11.Segments, Index=0, Wrap=True)  # -> Item, Item1, Item2, Item3
list_item_19 = ListItem(List=arc_3pt_2.Arc, Index=0, Wrap=True)  # -> Item, Item1, Item2, Item3
list_item_20 = ListItem(List=arc_3pt_2.Arc, Index=0, Wrap=True)  # -> Item, Item1, Item2, Item3
list_item_21 = ListItem(List=explode_11.Segments, Index=0, Wrap=True)  # -> Item, Item1, Item2, Item3
list_item_22 = ListItem(List=explode_11.Segments, Index=0, Wrap=True)  # -> Item, Item1, Item2, Item3
sweep2_5 = Sweep2(Rail1=list_item_16.Item, Rail2=list_item_16.Item2, Sections=list_item_18.Item1, SameHeight=False)
sweep2_6 = Sweep2(Rail1=list_item_20.Item1, Rail2=list_item_20.Item3, Sections=list_item_22.Item2, SameHeight=False)
sweep2_7 = Sweep2(Rail1=list_item_15.Item, Rail2=list_item_15.Item1, Sections=list_item_17.Item, SameHeight=False)
loft_5 = Loft(Curves=merge_3, Options={Adjust=False, Closed=False, LoftEnds=0, LoftSimp=0, LoftType=0, Rebuild=10, Refit=0.01})
sweep2_8 = Sweep2(Rail1=list_item_19.Item, Rail2=list_item_19.Item3, Sections=list_item_21.Item3, SameHeight=False)

curve_middle = CurveMiddle(Curve=line)

scale_6 = Scale(Geometry=curve_middle, Center=point_on_curve, Factor=number_slider_5)  # -> Geometry, Transform
arc_3pt_3 = Arc3Pt(PointA=end_points.Start, PointB=scale_6.Geometry, PointC=end_points.End)  # -> Arc, Plane, Radius
list_item_23 = ListItem(List=arc_3pt_3.Arc, Index=0, Wrap=True)  # -> Item, Item1, Item2, Item3
list_item_24 = ListItem(List=arc_3pt_3.Arc, Index=0, Wrap=True)  # -> Item, Item1, Item2, Item3
list_item_25 = ListItem(List=arc_3pt_3.Arc, Index=0, Wrap=True)  # -> Item, Item1, Item2, Item3
list_item_26 = ListItem(List=arc_3pt_3.Arc, Index=0, Wrap=True)  # -> Item, Item1, Item2, Item3
sweep2_9 = Sweep2(Rail1=list_item_24.Item, Rail2=list_item_24.Item2, Sections=list_item_4.Item1, SameHeight=False)
sweep2_10 = Sweep2(Rail1=list_item_26.Item1, Rail2=list_item_26.Item3, Sections=list_item_6.Item2, SameHeight=False)
sweep2_11 = Sweep2(Rail1=list_item_23.Item, Rail2=list_item_23.Item1, Sections=list_item_3.Item, SameHeight=False)
sweep2_12 = Sweep2(Rail1=list_item_25.Item, Rail2=list_item_25.Item3, Sections=list_item_5.Item3, SameHeight=False)
